vi "index.gviweb"   [LabVIEW NXG 3.1.0]
panel controls:
  "Height Offset of Box": f64 = 0.5
  "Button": bool
  "Tab": i32
  "Hyperlink Control": string = "https://sketchfab.com/models/031875966a5740f18ac4cffa8b14031d#"
  "Hyperlink Control_2": string = "https://medium.com/arjs/augmented-reality-in-10-lines-of-html-4e193ea9fdbf"
panel indicators:
  "URL Image": string
  "Output": error
uses:
  AugmentedReality::Create Scene.gviweb
  Resources::Placeholder.gviweb
diagram:
  while {
    Wait(time to wait=10)
    stop if $Button
  }
  call "Create Scene.gviweb"(selector=".eagle-demo", error in=no error) -> (error out=w1)
  s1 = w1  # shift register
  while {
    Wait(time to wait=10)
    stop if s1
  }
  $Output <- s1
  call "Placeholder.gviweb"()
