vi "index.gviweb"   [LabVIEW NXG 3.1.0]
panel indicators:
  "error out": error
uses:
  FileTasks::Read File Text.gvi
  FileTasks::Download File Text.gvi
diagram:
  call "Read File Text.gvi"(allowed file types=[".txt"]) -> (file content=w1, file name=w2, error out=w3)
  call "Download File Text.gvi"(file contents=w1, file name=w2, error in=w3) -> (error out=w4)
  $"error out" <- w4
