vi "Encode JSON.gvi"   [LabVIEW NXG 3.1.0]
inputs:
  "json tokens": "JSON Tokens.gtype", required
  "error in": error
outputs:
  "json string": string
  "error out": error
types:
  "JSON Token Type.gtype" = enum{"Array", "ArrayEnd", "ArrayDouble", "ArrayString", "ArrayBoolean", "Object", "ObjectKey", "ObjectEnd", "Double", "String", "True", "False", "Null"}
  "JSON Token.gtype" = cluster{"type": "JSON Token Type.gtype", "data": string, "offsets": i32[]}
  "JSON Tokens.gtype" = "JSON Token.gtype"[]
uses:
  JSONParser::Support::JSON Tokens to Encode JSON Tokens.gvi
  JSONParser::Support::JSONParser.jsli::JSONStringify
diagram:
  call "JSON Tokens to Encode JSON Tokens.gvi"(json tokens=$"json tokens") -> (encode json tokens=w1)
  Flatten To JSON(anything=w1, error in (no error)=$"error in") -> (JSON string=w2, error out=w3)
  call "JSONStringify"(tokensJSON=w2, error in=w3) -> (jsonString=w4, error out=w5)
  $"json string" <- w4
  $"error out" <- w5
