vi "BatteryLevel.gviweb"   [LabVIEW NXG 3.1.0]
panel controls:
  "Button": bool
panel indicators:
  "Output": error
  "value": u8[]
  "id": string
  "name": string
uses:
  WebBluetooth::UUID::Service UUID (String).gvi
  WebBluetooth::Filter::Set Filter Services.gvi
  WebBluetooth::Request Device.gvi
  WebBluetooth::WebBluetooth.jsli::GATT Server Connect
  WebBluetooth::WebBluetooth.jsli::Get Primary Service
  WebBluetooth::WebBluetooth.jsli::Get Characteristic
  WebBluetooth::WebBluetooth.jsli::Read Value
diagram:
  call "Service UUID (String).gvi"(name="battery_service") -> (uuid=w1)
  Build Array(w1) -> w2
  call "Set Filter Services.gvi"(service uuids=w2) -> (filter out=w3)
  Build Array(w3) -> w4
  call "Request Device.gvi"(selector=".start-bluetooth", filters=w4) -> (id=w5, name=w6)
  $id <- w5
  $name <- w6
  disable {
    frame Enabled { }
    frame Disabled {
      call "GATT Server Connect"() -> (gatt server refnum=w7, error out=w8)
      call "Get Primary Service"(gatt server refnum=w7, service="battery_service", error in=w8) -> (service refnum=w9, error out=w10)
      call "Get Characteristic"(service refnum=w9, characteristic="battery_level", error in=w10) -> (characteristic refnum=w11, error out=w12)
      call "Read Value"(charcteristic refnum=w11, error in=w12) -> (value=w13, error out=w14)
      $value <- w13
      $Output <- w14
    }
  }
