vi "index.gviweb"   [G Web Development Software 22.3.0]
panel indicators:
  "String": string
uses:
  WebVIDeno::Support::WebVIDeno.jsli::Log
  NI::G Core::Operating System::Write to System Log.gvi
diagram:
  $String <- "hello world!"
  call "Log"()
  call "Write to System Log.gvi"(message="hello world!")
